# Dynamo graph ARV_TaoSanCanHoTuCAD_v1.dyn (Dynamo 3.6.2.11575)
# author: Archivina BIM
# Tạo sàn hoàn thiện kiến trúc cho phòng ngủ, khách, WC, logia của các căn hộ trên level của view đang mở, lấy polyline căn + tên căn + cột + thiết bị WC từ CAD link, biên theo mặt tường Revit. Dry-run mặc định.

# group: 1. Đầu vào
# Mở view MẶT BẰNG của tầng cần làm (sàn tạo trên level của view), bản CAD mặt bằng Link đúng vị trí. Giữ Dry-run = True cho lần chạy đầu, đọc Báo cáo rồi mới đổi False. IN[14]: floor type ở IN[9] chưa có → tự nhân bản từ type kiến trúc mẫu này khi chạy thật. IN[15]: vẽ đường bo phòng (Detail Line) theo biên từng tấm sàn trên view đang mở. Ô cửa ngủ ↔ khách luôn có sàn gỗ, cửa WC có đá chân cửa. IN[16] = True: xoá sàn + bo cũ của tool rồi tạo lại.
in_0_tên_bản_cad_trống_bản_cad = StringInput("G19")  # "IN[0] Tên bản CAD (trống = bản CAD duy nhất)"; graph input
in_1_layer_polyline_căn_hộ = StringInput("00 do dt")  # graph input
in_2_layer_chữ_tên_căn = StringInput("A-Text")  # graph input
in_3_mẫu_tên_căn_regex = StringInput("^CH\d+")  # graph input
in_4_layer_cột_cad_khoét_khỏi = StringInput("A-Column")  # "IN[4] Layer cột CAD khoét khỏi sàn (trống = không)"; graph input
in_5_sàn_cách_mặt_cột_cad_mm = DoubleInput(15)  # graph input
in_6_cửa_ra_logia_tên_family = StringInput("trượt")  # "IN[6] Cửa ra logia: tên family/type chứa"; graph input
in_7_điểm_dò_logia_cách_tâm_cửa = DoubleInput(400)  # "IN[7] Điểm dò logia cách tâm cửa về phía Facing (mm)"; graph input
in_8_layer_thiết_bị_wc_trong_cad = StringInput("A-Interior WC")  # graph input
in_9_floor_type_theo_loại = StringInput("KHO=SHT-Gỗ Công Nghiệp;WC=SHT-Gach Lat WC-300x600;LOGIA=SHT-Gach Lat Logia-300x600;CHANCUA=FF-Đá Granite tự nhiên")  # graph input
in_10_cao_độ_mặt_sàn_so_với = StringInput("KHO=0;WC=-15;LOGIA=-30;CHANCUA=0")  # "IN[10] Cao độ mặt sàn so với Level (mm)"; graph input
in_11_wc_lùi_biên_thêm_mm = DoubleInput(10)  # graph input
in_12_chỉ_làm_các_căn_trống_tất = StringInput("")  # "IN[12] Chỉ làm các căn (trống = tất cả)"; graph input
in_13_dry_run_true_chỉ_báo_cáo = BoolSelector(false)  # "IN[13] DRY-RUN: True = chỉ báo cáo / False = GHI VÀO MÔ HÌNH"; graph input
in_14_floor_type_kiến_trúc_mẫu = StringInput("SHT-Gach Lat-600x600")  # "IN[14] Floor type kiến trúc mẫu để nhân bản type thiếu"; graph input
in_15_line_style_đường_bo_phòng = StringInput("AV.Nét Hatch Lát Sàn")  # "IN[15] Line style đường bo phòng (trống = không vẽ)"; graph input
in_16_tạo_lại_xoá_sàn_đường_bo = BoolSelector(false)  # "IN[16] Tạo lại: xoá sàn + đường bo cũ của tool trong các căn"; graph input

# group: 2. Tạo sàn (Python)
# Biên sàn = mặt hoàn thiện tường Revit (+ cột CAD nới 15 mm); vùng hở cắt theo polyline căn CAD; tên căn đọc từ DWG qua AutoCAD Core Console; logia theo cửa trượt, WC theo nét thiết bị CAD, còn lại sàn gỗ. WC lùi thêm 10 mm. Chặn file central, log CSV vào Documents\ARV_Logs. TRẠNG THÁI: CHƯA DUYỆT.
tạo_sàn_căn_hộ_python = Python(IN[0]=in_0_tên_bản_cad_trống_bản_cad, IN[1]=in_1_layer_polyline_căn_hộ, IN[2]=in_2_layer_chữ_tên_căn, IN[3]=in_3_mẫu_tên_căn_regex, IN[4]=in_4_layer_cột_cad_khoét_khỏi, IN[5]=in_5_sàn_cách_mặt_cột_cad_mm, IN[6]=in_6_cửa_ra_logia_tên_family, IN[7]=in_7_điểm_dò_logia_cách_tâm_cửa, IN[8]=in_8_layer_thiết_bị_wc_trong_cad, IN[9]=in_9_floor_type_theo_loại, IN[10]=in_10_cao_độ_mặt_sàn_so_với, IN[11]=in_11_wc_lùi_biên_thêm_mm, IN[12]=in_12_chỉ_làm_các_căn_trống_tất, IN[13]=in_13_dry_run_true_chỉ_báo_cáo, IN[14]=in_14_floor_type_kiến_trúc_mẫu, IN[15]=in_15_line_style_đường_bo_phòng, IN[16]=in_16_tạo_lại_xoá_sàn_đường_bo)  # CPython3
# ---------- tạo_sàn_căn_hộ_python.python (1334 lines) ----------
# TRẠNG THÁI: CHƯA DUYỆT
# Mã nguồn của Python node trong ARV_TaoSanCanHoTuCAD_v1.dyn (bản để review; .dyn nhúng đúng nội dung này).
# Revit 2026 / Dynamo 3.6 (CPython3)
#
# Tạo sàn hoàn thiện kiến trúc (Floor) cho phòng ngủ, phòng khách, WC, logia của các căn hộ trên level của view
# mặt bằng đang mở, lấy thông tin từ bản CAD mặt bằng đã Link (không cần đường bo phòng / hatch trong CAD):
#   1. Căn hộ  = polyline kín layer IN[1] (mặc định "00 do dt", > 20 m²); tên căn = TEXT/MTEXT layer IN[2] khớp mẫu
#      IN[3] (mặc định CH01…), gán cho polyline gần nhất. Chữ đọc từ bản sao DWG qua AutoCAD Core Console.
#   2. Biên sàn = mặt hoàn thiện tường Revit (tường thẳng, tường liền qua ô cửa): vùng bao các căn trừ khối tường
#      (dài tới mặt tường nối ở hai đầu) và trừ cột CAD layer IN[4] nới thêm IN[5] mm (lớp trát, mặc định 15)
#      → tách thành các vùng rời. Vùng kín nằm trong căn giữ nguyên; vùng hở (logia không có tường lan can, sảnh hở
#      ra hành lang, phía ngoài nhà) cắt theo polyline căn.
#   3. Loại phòng: có điểm dò cửa ra logia (family chứa IN[6], dò IN[7] mm về phía Facing) → LOGIA; có ≥ 5 điểm nét
#      thiết bị CAD layer IN[8] → WC (> 10 m² → chỉ báo "KIỂM TRA", không tạo); vùng hở ≤ 6 m² (không có tường
#      Revit bao kín, VD logia giặt có máy giặt, cửa đi mở quay) → LOGIA; còn lại → phòng khô (lớn nhất căn
#      = khách, ≥ 6 m² = ngủ, nhỏ hơn = sảnh / kho). Phòng khô dùng chung một floor type.
#   4. WC lùi biên thêm IN[11] = 10 mm khỏi mặt trát (= dày gạch ốp, KTS chốt 2026-10-20). Tường ốp mỏng < 30 mm
#      (VD "GO-Gạch ốp-300x600" 10 mm) không làm biên sàn → biên WC trùng mặt gạch ốp.
#   5. Floor type / cao độ mặt sàn theo loại (IN[9], IN[10]). Bỏ qua vùng < 0,5 m² (hộp kỹ thuật) và dải mảnh
#      rộng TB < 300 mm. Bỏ qua phòng đã có sàn tạo bởi tool này. Comments = "ARV-SanCanHo <căn> <loại>".
# INPUT
#   IN[0]  (str)  Một phần tên bản CAD (trống = bản CAD duy nhất)
#   IN[1]  (str)  Layer polyline căn hộ (khớp chuỗi con, cách ';'), VD "00 do dt"
#   IN[2]  (str)  Layer chữ tên căn, VD "A-Text"
#   IN[3]  (str)  Mẫu tên căn (regex), VD "^CH\d+"
#   IN[4]  (str)  Layer cột CAD khoét khỏi sàn, VD "A-Column" (trống = không khoét)
#   IN[5]  (num)  Sàn cách mặt cột CAD (mm), VD 15
#   IN[6]  (str)  Nhận cửa ra logia theo tên family/type (chuỗi con, cách ';'), VD "trượt"
#   IN[7]  (num)  Điểm dò logia cách tâm cửa về phía Facing (mm), VD 400
#   IN[8]  (str)  Layer thiết bị WC trong CAD, VD "A-Interior WC"
#   IN[9]  (str)  Floor type theo loại: "KHO=…;WC=…;LOGIA=…"
#   IN[10] (str)  Cao độ mặt sàn so với Level (mm): "KHO=0;WC=-15;LOGIA=-30"
#   IN[11] (num)  WC lùi biên khỏi mặt trát (mm) = dày gạch ốp, VD 10
#   IN[12] (str)  Chỉ làm các căn (cách ';', VD "CH01;CH02"; trống = tất cả)
#   IN[13] (bool) Dry-run: True = chỉ báo cáo + xem trước (mặc định True)
#   IN[14] (str)  Floor type kiến trúc mẫu: type ở IN[9] chưa có → nhân bản từ type này đúng tên đó, giữ cấu tạo lớp
#                 (chỉ khi chạy thật và có tấm sàn dùng). Trống = dừng khi thiếu type.
#   IN[15] (str)  Line style vẽ đường bo phòng (Detail Line trên view đang mở, theo đúng biên từng tấm sàn tạo,
#                 kể cả lỗ), VD "AV.Nét Hatch Lát Sàn" – phải có sẵn trong file. Trống = không vẽ.
#   Ô cửa (luôn làm): lỗ cửa đo trên tường Revit × bề dày tường. Phòng khô ↔ phòng khô (ngủ ↔ khách) → sàn phòng
#   khô (Comments …KHO-CUA); phòng khô ↔ WC → đá chân cửa CHANCUA (IN[9]/IN[10], kéo thêm IN[11] mm về phía WC).
#   Chiều hatch: Revit đặt hatch song song cạnh dài nhất của biên → sàn khô của căn được chia cạnh (force_dir) để
#   cùng chiều cạnh dài nhất phòng khách.
#   IN[16] (bool) Tạo lại: xoá sàn cũ của tool (Comments ARV-SanCanHo) trong các căn đang làm + mọi Detail Line
#                 line style IN[15] trên view nằm trong các căn đó (cách polyline căn ≤ 300 mm), rồi tạo lại
#                 (mặc định False). Không bật: nét bo đã có trùng vị trí được giữ, không vẽ chồng.
# OUTPUT
#   OUT[0] (list[str])  Báo cáo: tóm tắt, cảnh báo, đường dẫn log, từng tấm sàn
#   OUT[1] (list[Line]) Xem trước: biên các tấm sàn sẽ tạo (mm, tại cao độ Level)

import os
import io
import re
import csv
import glob
import math
import shutil
import tempfile
import datetime
import subprocess
import unicodedata

DYNAMO = "IN" in globals()

if DYNAMO:
    import clr
    clr.AddReference("RevitAPI")
    from Autodesk.Revit.DB import (FilteredElementCollector, ImportInstance, CADLinkType, XYZ, Line, Arc, CurveLoop,
                                   PolyLine, Transaction, UnitUtils, UnitTypeId, ModelPathUtils, BuiltInParameter,
                                   BuiltInCategory, Floor, FloorType, Wall, LocationCurve, LocationPoint,
                                   FamilyInstance, Options, GeometryInstance, PlanarFace, ViewPlan,
                                   GeometryCreationUtilities, BooleanOperationsUtils, BooleanOperationsType,
                                   SolidUtils, GraphicsStyleType, Solid, SolidCurveIntersectionOptions,
                                   SolidCurveIntersectionMode, ElementId)
    clr.AddReference("RevitServices")
    from RevitServices.Persistence import DocumentManager
    from RevitServices.Transactions import TransactionManager
    from System.Collections.Generic import List
    doc = DocumentManager.Instance.CurrentDBDocument
    uidoc = DocumentManager.Instance.CurrentUIApplication.ActiveUIDocument

TRANSACTION_NAME = u"ARV - Tạo sàn căn hộ từ CAD"
SCRIPT_TAG = u"ARV_TaoSanCanHoTuCAD_v1"
COMMENT_TAG = u"ARV-SanCanHo"
KINDS = ("KHO", "WC", "LOGIA", "CHANCUA")   # CHANCUA = đá chân cửa WC (ô cửa phòng khô ↔ WC)
CORE_TIMEOUT_S = 180
MIN_APT_M2 = 20.0         # Polyline căn tối thiểu
MAX_LABEL_MM = 6000.0     # Tên căn cách polyline căn tối đa (chữ thường đặt ngoài mặt bằng)
MIN_PIECE_M2 = 0.5        # Vùng nhỏ hơn = hộp kỹ thuật, bỏ
MIN_WIDTH_MM = 300.0      # Dải mảnh (rộng TB = 2·DT/chu vi) nhỏ hơn → bỏ
OPEN_MM = 250.0           # Đỉnh vùng ra ngoài polyline căn quá giá trị này → vùng hở, cắt theo polyline căn
MARGIN_MM = 2000.0        # Nới vùng bao các căn
WC_MIN_PTS = 5            # Số điểm nét thiết bị WC tối thiểu trong phòng
WC_MAX_M2 = 10.0
BEDROOM_MIN_M2 = 6.0
OPEN_LOGIA_MAX_M2 = 6.0   # Vùng hở (không có tường Revit bao kín) nhỏ hơn, không có thiết bị WC → logia
THIN_WALL_MM = 30.0       # Tường mỏng hơn = tường ốp (gạch ốp WC), không làm biên sàn
PROBE_Z_MM = 300.0       # Tường được tính nếu cắt qua cao độ Level + 300
DUP_PT_MM = 2.0
COLLINEAR_MM = 0.5
INNER_MM = 20.0


class StopReport(Exception):
    def __init__(self, lines):
        Exception.__init__(self, lines[0])
        self.lines = lines


# --- Hình học 2D thuần (mm) – chạy được ngoài Revit để thử --------------------------
def fmt(p):
    return u"({:.0f}, {:.0f})".format(p[0], p[1])


def signed_area(pts):
    return sum(pts[i][0] * pts[(i + 1) % len(pts)][1] - pts[(i + 1) % len(pts)][0] * pts[i][1]
               for i in range(len(pts))) / 2.0


def perimeter(pts):
    return sum(math.hypot(pts[(i + 1) % len(pts)][0] - pts[i][0], pts[(i + 1) % len(pts)][1] - pts[i][1])
               for i in range(len(pts)))


def point_in(pt, pts):
    x, y = pt
    inside = False
    j = len(pts) - 1
    for i in range(len(pts)):
        xi, yi = pts[i]
        xj, yj = pts[j]
        if (yi > y) != (yj > y) and x < (xj - xi) * (y - yi) / (yj - yi) + xi:
            inside = not inside
        j = i
    return inside


def seg_dist(p, a, b):
    dx, dy = b[0] - a[0], b[1] - a[1]
    l2 = dx * dx + dy * dy
    t = 0.0 if l2 == 0 else max(0.0, min(1.0, ((p[0] - a[0]) * dx + (p[1] - a[1]) * dy) / l2))
    return math.hypot(p[0] - a[0] - t * dx, p[1] - a[1] - t * dy)


def dist_outside(p, pts):
    """0 nếu p nằm trong đa giác, ngược lại khoảng cách tới cạnh gần nhất."""
    if point_in(p, pts):
        return 0.0
    return min(seg_dist(p, pts[i], pts[(i + 1) % len(pts)]) for i in range(len(pts)))


def clean_poly(pts):
    """Bỏ đỉnh trùng (≤ DUP_PT_MM) và đỉnh thẳng hàng, đưa về ngược chiều kim đồng hồ.
    Đỉnh thẳng hàng làm Floor.Create báo lỗi nội bộ (vòng biên có hai cạnh nối tiếp cùng phương)."""
    out = []
    for p in pts:
        if not out or math.hypot(p[0] - out[-1][0], p[1] - out[-1][1]) > DUP_PT_MM:
            out.append(p)
    if len(out) > 1 and math.hypot(out[0][0] - out[-1][0], out[0][1] - out[-1][1]) <= DUP_PT_MM:
        out.pop()
    changed = True
    while changed and len(out) > 3:
        changed = False
        for i in range(len(out)):
            a, b, c = out[i - 1], out[i], out[(i + 1) % len(out)]
            ab = math.hypot(b[0] - a[0], b[1] - a[1])
            if ab == 0 or abs((b[0] - a[0]) * (c[1] - a[1]) - (b[1] - a[1]) * (c[0] - a[0])) / ab < COLLINEAR_MM:
                out.pop(i)
                changed = True
                break
    if len(out) >= 3 and signed_area(out) < 0:
        out.reverse()
    return out


def interior_point(pts, holes=()):
    """Điểm chắc chắn nằm trong đa giác (CCW), ngoài các lỗ: trung điểm cạnh dài nhất lùi vào trong INNER_MM."""
    edges = sorted(range(len(pts)), key=lambda i: -math.hypot(pts[(i + 1) % len(pts)][0] - pts[i][0],
                                                              pts[(i + 1) % len(pts)][1] - pts[i][1]))
    for i in edges:
        a, b = pts[i], pts[(i + 1) % len(pts)]
        l = math.hypot(b[0] - a[0], b[1] - a[1])
        if l < 3 * INNER_MM:
            continue
        p = ((a[0] + b[0]) / 2.0 - (b[1] - a[1]) / l * INNER_MM, (a[1] + b[1]) / 2.0 + (b[0] - a[0]) / l * INNER_MM)
        if point_in(p, pts) and not any(point_in(p, h) for h in holes):
            return p
    return (sum(p[0] for p in pts) / len(pts), sum(p[1] for p in pts) / len(pts))


def bbox(pts):
    xs = [p[0] for p in pts]
    ys = [p[1] for p in pts]
    return min(xs), min(ys), max(xs), max(ys)


def bbox_overlap(a, b):
    return a[0] <= b[2] and b[0] <= a[2] and a[1] <= b[3] and b[1] <= a[3]


def in_region(p, outer, holes):
    return point_in(p, outer) and not any(point_in(p, h) for h in holes)


def match_names(labels, apts):
    """labels: [(tên, (x, y))], apts: [đa giác] → {chỉ số đa giác: tên}. Ghép cặp gần nhất trước, mỗi bên một lần."""
    pairs = sorted((dist_outside(p, poly), name, i) for name, p in labels for i, poly in enumerate(apts))
    used_n, result = set(), {}
    for d, name, i in pairs:
        if d > MAX_LABEL_MM or name in used_n or i in result:
            continue
        used_n.add(name)
        result[i] = name
    return result


def parse_map(text):
    result = {}
    for part in (text or u"").split(u";"):
        if u"=" in part:
            k, v = part.split(u"=", 1)
            if k.strip():
                result[k.strip().upper()] = v.strip()
    return result


def split_filters(text):
    return [s.strip() for s in (text or u"").split(u";") if s.strip()]


def norm(s):
    return unicodedata.normalize("NFC", (s or u"")).strip()


def matches(layer, filters):
    l = norm(layer).lower()
    return any(norm(f).lower() in l for f in filters)


# --- Đọc chữ trong DWG bằng AutoCAD Core Console --------------------------------------
def find_accoreconsole():
    found = glob.glob(r"C:\Program Files\Autodesk\AutoCAD *\accoreconsole.exe")
    return sorted(found)[-1] if found else None


def core_env(core):
    """Môi trường sạch cho AutoCAD Core Console. Gọi từ Revit, tiến trình con kế thừa Path có thư mục Revit 2026
    → Core Console nạp nhầm DLL của Revit, báo "Unable to load the Modeler DLLs" và thoát, không xuất file
    (đã kiểm 2026-10-19). Chỉ giữ biến hệ thống, Path = thư mục AutoCAD + Windows."""
    keep = ("SYSTEMROOT", "WINDIR", "SYSTEMDRIVE", "USERPROFILE", "APPDATA", "LOCALAPPDATA", "USERNAME",
            "USERDOMAIN", "PROGRAMDATA", "PROGRAMFILES", "PROGRAMFILES(X86)", "PROGRAMW6432", "COMMONPROGRAMFILES",
            "COMMONPROGRAMFILES(X86)", "COMMONPROGRAMW6432", "ALLUSERSPROFILE", "COMPUTERNAME", "HOMEDRIVE",
            "HOMEPATH", "OS", "NUMBER_OF_PROCESSORS", "PROCESSOR_ARCHITECTURE", "PUBLIC", "COMSPEC", "PATHEXT")
    env = dict((k, v) for k, v in os.environ.items() if k.upper() in keep)
    root = env.get("SYSTEMROOT") or os.environ.get("SystemRoot") or r"C:\Windows"
    temp = os.path.join(os.environ.get("LOCALAPPDATA") or os.path.expanduser("~"), "Temp")
    env["TEMP"] = env["TMP"] = temp if os.path.isdir(temp) else tempfile.gettempdir()
    env["PATH"] = u";".join([os.path.dirname(core), os.path.join(root, "System32"), root,
                             os.path.join(root, "System32", "Wbem")])
    return env


def clean_mtext(s):
    s = re.sub(r"\\[A-Za-z][^;\\{}]*;", "", s)   # \fArial|b0;  \H2.5;  \C1; ...
    s = re.sub(r"\\[Pp~]", " ", s)
    return s.replace("{", "").replace("}", "").strip()


# Đọc TEXT/MTEXT ở model space VÀ trong block (lồng nhau, tối đa 8 cấp): toạ độ đổi về WCS theo ma trận affine của
# từng INSERT. Chữ trên layer "0" trong block lấy layer của INSERT cha. (Giống ARV_TaoDamTuCAD_v1.)
DUMP_LISP = u"""(setq f (open "{out}" "w" "utf8"))
(defun _ap (m p) (list (+ (* (nth 0 m) (car p)) (* (nth 1 m) (cadr p)) (nth 4 m))
                       (+ (* (nth 2 m) (car p)) (* (nth 3 m) (cadr p)) (nth 5 m))))
(defun _mul (p c) (list (+ (* (nth 0 p) (nth 0 c)) (* (nth 1 p) (nth 2 c)))
                        (+ (* (nth 0 p) (nth 1 c)) (* (nth 1 p) (nth 3 c)))
                        (+ (* (nth 2 p) (nth 0 c)) (* (nth 3 p) (nth 2 c)))
                        (+ (* (nth 2 p) (nth 1 c)) (* (nth 3 p) (nth 3 c)))
                        (+ (* (nth 0 p) (nth 4 c)) (* (nth 1 p) (nth 5 c)) (nth 4 p))
                        (+ (* (nth 2 p) (nth 4 c)) (* (nth 3 p) (nth 5 c)) (nth 5 p))))
(defun _ins (d / a sx sy ip bp ca sa m)
  (setq a (cdr (assoc 50 d)) sx (cdr (assoc 41 d)) sy (cdr (assoc 42 d)) ip (cdr (assoc 10 d))
        bp (cdr (assoc 10 (tblsearch "BLOCK" (cdr (assoc 2 d))))) ca (cos a) sa (sin a))
  (setq m (list (* ca sx) (- (* sa sy)) (* sa sx) (* ca sy) 0.0 0.0) bp (_ap m bp))
  (list (nth 0 m) (nth 1 m) (nth 2 m) (nth 3 m) (- (car ip) (car bp)) (- (cadr ip) (cadr bp))))
(defun _lay (d parent / l) (setq l (cdr (assoc 8 d))) (if (and parent (= l "0")) parent l))
(defun _txt (d m lay / p q)
  (setq p (if (and (= (cdr (assoc 0 d)) "TEXT") (or (/= 0 (cdr (assoc 72 d))) (/= 0 (cdr (assoc 73 d)))))
            (cdr (assoc 11 d)) (cdr (assoc 10 d))))
  (setq q (_ap m p))
  (write-line (strcat (substr (cdr (assoc 0 d)) 1 1) "|" lay "|" (rtos (car q) 2 3) "," (rtos (cadr q) 2 3) "|"
                      (cdr (assoc 1 d))) f))
(defun _walk (name m parent depth / e d)
  (setq e (cdr (assoc -2 (tblsearch "BLOCK" name))))
  (while e
    (setq d (entget e))
    (cond ((member (cdr (assoc 0 d)) '("TEXT" "MTEXT")) (_txt d m (_lay d parent)))
          ((and (= (cdr (assoc 0 d)) "INSERT") (< depth 8))
            (_walk (cdr (assoc 2 d)) (_mul m (_ins d)) (_lay d parent) (1+ depth))))
    (setq e (entnext e))))
(if (setq ss (ssget "_X" '((0 . "TEXT,MTEXT,INSERT") (410 . "Model"))))
  (progn (setq i 0)
    (repeat (sslength ss)
      (setq d (entget (ssname ss i)) i (1+ i))
      (if (= (cdr (assoc 0 d)) "INSERT")
        (_walk (cdr (assoc 2 d)) (_ins d) (cdr (assoc 8 d)) 1)
        (_txt d '(1.0 0.0 0.0 1.0 0.0 0.0) (cdr (assoc 8 d)))))))
(close f)
"""


def read_dwg_texts(dwg_path, core):
    """[(layer, text, x, y)] theo toạ độ DWG (mm). Chạy trên bản sao trong thư mục tạm – không mở file gốc."""
    work = tempfile.mkdtemp(prefix="ARV_SanCanHo_")
    try:
        copy = os.path.join(work, "copy.dwg")
        shutil.copy2(dwg_path, copy)
        out = os.path.join(work, "texts.txt")
        scr = os.path.join(work, "dump.scr")
        with io.open(scr, "w", encoding="utf-8") as f:
            f.write(DUMP_LISP.replace("{out}", out.replace("\\", "/")))
        subprocess.run([core, "/i", copy, "/s", scr, "/l", "en-US"], stdin=subprocess.DEVNULL,
                       env=core_env(core), cwd=os.path.dirname(core),
                       stdout=subprocess.DEVNULL, stderr=subprocess.DEVNULL,
                       timeout=CORE_TIMEOUT_S, creationflags=0x08000000)
        if not os.path.isfile(out):
            raise Exception(u"Core Console không xuất được danh sách chữ")
        texts = []
        with io.open(out, "r", encoding="utf-8-sig", errors="replace") as f:
            for line in f.read().splitlines():
                parts = line.split("|")
                if len(parts) < 4:
                    continue
                kind, layer, xy = parts[0], parts[1], parts[2]
                text = u"|".join(parts[3:])
                if kind == "M":
                    text = clean_mtext(text)
                try:
                    x, y = [float(v) for v in xy.split(",")]
                except ValueError:
                    continue
                if text.strip():
                    texts.append((layer, text.strip(), x, y))
        return texts
    finally:
        shutil.rmtree(work, ignore_errors=True)


# --- Revit: tiện ích -------------------------------------------------------------------
def to_mm(feet):
    return UnitUtils.ConvertFromInternalUnits(feet, UnitTypeId.Millimeters)


def from_mm(mm):
    return UnitUtils.ConvertToInternalUnits(mm, UnitTypeId.Millimeters)


def get_name(element):
    try:
        return element.Name
    except Exception:
        p = element.get_Parameter(BuiltInParameter.ALL_MODEL_TYPE_NAME)
        return p.AsString() if p else u""


def type_name(t):
    p = t.get_Parameter(BuiltInParameter.SYMBOL_NAME_PARAM)
    return p.AsString() if p else get_name(t)


def id_value(eid):
    v = getattr(eid, "Value", None)
    return v if v is not None else eid.IntegerValue


def is_central_file(document):
    if not document.IsWorkshared:
        return False
    try:
        central = ModelPathUtils.ConvertModelPathToUserVisiblePath(document.GetWorksharingCentralModelPath())
    except Exception:
        return False
    return os.path.normcase(central or "") == os.path.normcase(document.PathName or "")


def pick_cad(cad_filter):
    all_cad = list(FilteredElementCollector(doc).OfClass(ImportInstance).ToElements())
    instances = all_cad
    if cad_filter:
        instances = [i for i in all_cad if cad_filter.lower() in get_name(doc.GetElement(i.GetTypeId())).lower()]
    if len(instances) != 1:
        names = [get_name(doc.GetElement(i.GetTypeId())) for i in all_cad]
        raise StopReport([u"DỪNG: tìm thấy {} bản CAD khớp '{}'. Nhập tên bản CAD vào ô IN[0]. Các bản CAD: {}".format(
            len(instances), cad_filter, u", ".join(names) or u"không có")])
    return instances[0]


def cad_file_path(inst):
    link = doc.GetElement(inst.GetTypeId())
    if not inst.IsLinked or not isinstance(link, CADLinkType):
        return None
    try:
        ref = link.GetExternalFileReference()
        return ModelPathUtils.ConvertModelPathToUserVisiblePath(ref.GetAbsolutePath())
    except Exception:
        return None


def layer_of(obj):
    gs = doc.GetElement(obj.GraphicsStyleId)
    cat = gs.GraphicsStyleCategory if gs is not None else None
    return cat.Name if cat is not None else u""


def read_link_geometry(inst, apt_filters, col_filters, wc_filters):
    """Hình học bản CAD link theo toạ độ mô hình (mm): polyline kín căn, polyline kín cột, điểm nét thiết bị WC."""
    apts, cols, wc_pts = [], [], []

    def closed_pts(pl):
        c = [(to_mm(p.X), to_mm(p.Y)) for p in pl.GetCoordinates()]
        if len(c) > 3 and math.hypot(c[0][0] - c[-1][0], c[0][1] - c[-1][1]) < 1.0:
            return clean_poly(c[:-1])
        return None

    def walk(geo):
        for o in geo:
            if isinstance(o, GeometryInstance):
                walk(o.GetInstanceGeometry())
                continue
            lay = layer_of(o)
            if wc_filters and matches(lay, wc_filters):
                if isinstance(o, PolyLine):
                    wc_pts.extend((to_mm(p.X), to_mm(p.Y)) for p in o.GetCoordinates())
                elif isinstance(o, Arc) and not o.IsBound:
                    wc_pts.append((to_mm(o.Center.X), to_mm(o.Center.Y)))
                elif hasattr(o, "Evaluate") and getattr(o, "IsBound", False):
                    p = o.Evaluate(0.5, True)
                    wc_pts.append((to_mm(p.X), to_mm(p.Y)))
                continue
            if not isinstance(o, PolyLine):
                continue
            if matches(lay, apt_filters):
                c = closed_pts(o)
                if c and len(c) >= 3 and abs(signed_area(c)) / 1e6 >= MIN_APT_M2:
                    apts.append(c)
            elif col_filters and matches(lay, col_filters):
                c = closed_pts(o)
                if c and len(c) >= 3:
                    cols.append(c)

    geo = inst.get_Geometry(Options())
    if geo is not None:
        walk(geo)
    return apts, cols, wc_pts


def poly_loop(pts_mm, z):
    loop = CurveLoop()
    ps = [XYZ(from_mm(x), from_mm(y), z) for x, y in pts_mm]
    for i in range(len(ps)):
        loop.Append(Line.CreateBound(ps[i], ps[(i + 1) % len(ps)]))
    return loop


def prism(loop, height):
    return GeometryCreationUtilities.CreateExtrusionGeometry(List[CurveLoop]([loop]), XYZ.BasisZ, height)


def loop_pts(loop):
    pts = []
    for c in loop:
        if isinstance(c, Line):
            p = c.GetEndPoint(0)
            pts.append((to_mm(p.X), to_mm(p.Y)))
        else:
            pts.extend((to_mm(p.X), to_mm(p.Y)) for p in list(c.Tessellate())[:-1])
    return pts


def joined_half_width(loc, end, self_id):
    """Nửa bề dày lớn nhất của tường nối ở đầu end (0 nếu đầu tự do) – khối tường kéo tới đúng mặt tường kia."""
    try:
        others = loc.get_ElementsAtJoin(end)
    except Exception:
        try:
            others = loc.ElementsAtJoin[end]
        except Exception:
            return 0.0
    best = 0.0
    for o in others:
        if isinstance(o, Wall) and o.Id != self_id:
            best = max(best, o.Width / 2.0)
    return best


def wall_cutters(level, z, warns):
    """Khối đặc bề dày toàn phần (gồm lớp trát) của tường cắt qua cao độ Level + PROBE_Z_MM; không có lỗ cửa."""
    zc = z + from_mm(PROBE_Z_MM)
    cutters, skipped, thin = [], 0, 0
    for w in FilteredElementCollector(doc).OfClass(Wall).ToElements():
        bb = w.get_BoundingBox(None)
        loc = w.Location
        if bb is None or not isinstance(loc, LocationCurve) or bb.Min.Z > zc or bb.Max.Z < zc:
            continue
        if w.Width < from_mm(THIN_WALL_MM):
            # Tường ốp mỏng (gạch ốp WC 10 mm…) không làm biên sàn: biên WC lấy mặt trát − IN[11] (= dày gạch ốp),
            # như nhau dù chỗ đó đã dựng tường ốp hay chưa
            thin += 1
            continue
        crv = loc.Curve
        t = w.Width / 2.0
        if isinstance(crv, Line):
            ext = [joined_half_width(loc, 0, w.Id), joined_half_width(loc, 1, w.Id)]
            chords = [(crv.GetEndPoint(0), crv.GetEndPoint(1), ext[0], ext[1])]
        else:
            pts = list(crv.Tessellate())
            if len(pts) < 2:
                skipped += 1
                continue
            chords = [(pts[i], pts[i + 1], t if i > 0 else 0.0, t if i < len(pts) - 2 else 0.0)
                      for i in range(len(pts) - 1)]
        for a, b, e0, e1 in chords:
            d = XYZ(b.X - a.X, b.Y - a.Y, 0)
            if d.GetLength() < from_mm(1):
                continue
            d = d.Normalize()
            n = XYZ(-d.Y, d.X, 0)
            a = XYZ(a.X, a.Y, z - 0.5).Subtract(d.Multiply(e0))
            b = XYZ(b.X, b.Y, z - 0.5).Add(d.Multiply(e1))
            ps = [a.Add(n.Multiply(t)), a.Subtract(n.Multiply(t)), b.Subtract(n.Multiply(t)), b.Add(n.Multiply(t))]
            loop = CurveLoop()
            for i in range(4):
                loop.Append(Line.CreateBound(ps[i], ps[(i + 1) % 4]))
            cutters.append(prism(loop, 2.0))
    if skipped:
        warns.append(u"Bỏ qua {} tường không đọc được đường định vị".format(skipped))
    if thin:
        warns.append(u"{} tường ốp mỏng < {:.0f} mm không làm biên sàn (biên WC = mặt trát − IN[11])".format(
            thin, THIN_WALL_MM))
    return cutters


def column_cutters(cols, gap_mm, z):
    cutters = []
    for c in cols:
        loop = poly_loop(c, z - 0.5)
        best = None
        for s in ((1.0, -1.0) if gap_mm > 0 else (0.0,)):
            try:
                l = CurveLoop.CreateViaOffset(loop, from_mm(gap_mm) * s, XYZ.BasisZ) if s else loop
                sol = prism(l, 2.0)
                if best is None or sol.Volume > best.Volume:
                    best = sol
            except Exception:
                pass
        if best is not None:
            cutters.append(best)
    return cutters


def solid_regions(solid):
    """Mặt đáy của khối → [(vòng ngoài, [vòng lỗ])] theo mm, đã làm sạch."""
    result = []
    for f in solid.Faces:
        if not isinstance(f, PlanarFace) or f.FaceNormal.Z > -0.9:
            continue
        loops = [clean_poly(loop_pts(l)) for l in f.GetEdgesAsCurveLoops()]
        loops = [l for l in loops if len(l) >= 3]
        if not loops:
            continue
        loops.sort(key=lambda l: -abs(signed_area(l)))
        result.append((loops[0], loops[1:]))
    return result


def offset_outer(outer, dist_mm, z):
    """Lùi vòng ngoài vào trong dist_mm (chọn chiều cho diện tích nhỏ hơn)."""
    loop = poly_loop(outer, z)
    best = None
    for s in (1.0, -1.0):
        try:
            l = CurveLoop.CreateViaOffset(loop, from_mm(dist_mm) * s, XYZ.BasisZ)
            p = clean_poly(loop_pts(l))
            if len(p) >= 3 and (best is None or abs(signed_area(p)) < abs(signed_area(best))):
                best = p
        except Exception:
            pass
    return best


def existing_floor_polys(level):
    """Các sàn đã tạo bởi tool này trên level: [(vòng biên mm, Id, tên căn, Floor)] – mỗi vòng sketch một dòng."""
    polys = []
    for fl in FilteredElementCollector(doc).OfClass(Floor).ToElements():
        if fl.LevelId != level.Id:
            continue
        cm = fl.get_Parameter(BuiltInParameter.ALL_MODEL_INSTANCE_COMMENTS)
        text = (cm.AsString() or u"") if cm is not None else u""
        if not text.startswith(COMMENT_TAG):
            continue
        parts = text.split()
        apt = parts[1] if len(parts) > 1 else u""
        try:
            sk = doc.GetElement(fl.SketchId)
            for arr in sk.Profile:
                pts = []
                for c in arr:
                    pts.extend((to_mm(p.X), to_mm(p.Y)) for p in list(c.Tessellate())[:-1])
                if len(pts) >= 3:
                    polys.append((pts, id_value(fl.Id), apt, fl))
        except Exception:
            pass
    return polys


def seg_key(a, b):
    """Khoá đoạn thẳng không phân biệt chiều, làm tròn mm – nhận nét đường bo trùng vị trí."""
    return frozenset([(int(round(a[0])), int(round(a[1]))), (int(round(b[0])), int(round(b[1])))])


def edge_dir(pts):
    """Góc (rad, mod π) của cạnh dài nhất."""
    best, ang = -1.0, 0.0
    for i in range(len(pts)):
        a, b = pts[i], pts[(i + 1) % len(pts)]
        l = math.hypot(b[0] - a[0], b[1] - a[1])
        if l > best:
            best, ang = l, math.atan2(b[1] - a[1], b[0] - a[0])
    return ang % math.pi


def force_dir(pts, ang):
    """Revit đặt mẫu hatch sàn SONG SONG CẠNH DÀI NHẤT của biên (đã thử 2026-10-20: thứ tự cạnh, SpanDirectionAngle
    không có tác dụng). Muốn hatch theo hướng ang: chia các cạnh khác hướng thành nhiều đoạn thẳng hàng ngắn hơn
    cạnh dài nhất cùng hướng ang (Floor.Create nhận đỉnh thẳng hàng). Không có cạnh cùng hướng → giữ nguyên."""
    def par(a, b):
        return abs(math.sin(math.atan2(b[1] - a[1], b[0] - a[0]) - ang)) < 0.02
    n = len(pts)
    lmax = max([math.hypot(pts[(i + 1) % n][0] - pts[i][0], pts[(i + 1) % n][1] - pts[i][1])
                for i in range(n) if par(pts[i], pts[(i + 1) % n])] or [0.0])
    if lmax < 50.0:
        return pts
    out = []
    for i in range(n):
        a, b = pts[i], pts[(i + 1) % n]
        out.append(a)
        l = math.hypot(b[0] - a[0], b[1] - a[1])
        if par(a, b) or l < 0.95 * lmax:
            continue
        k = int(math.ceil(l / (0.8 * lmax)))
        out += [(a[0] + (b[0] - a[0]) * j / k, a[1] + (b[1] - a[1]) * j / k) for j in range(1, k)]
    return out


def extend_toward(rect, pt, dist):
    """Dời cạnh của chữ nhật gần điểm pt nhất ra ngoài thêm dist (mm) về phía pt."""
    n = len(rect)
    best, bi = None, 0
    for i in range(n):
        d = seg_dist(pt, rect[i], rect[(i + 1) % n])
        if best is None or d < best:
            best, bi = d, i
    a, b = rect[bi], rect[(bi + 1) % n]
    l = math.hypot(b[0] - a[0], b[1] - a[1]) or 1.0
    nx, ny = -(b[1] - a[1]) / l, (b[0] - a[0]) / l
    if (pt[0] - a[0]) * nx + (pt[1] - a[1]) * ny < 0:
        nx, ny = -nx, -ny
    out = list(rect)
    out[bi] = (a[0] + nx * dist, a[1] + ny * dist)
    out[(bi + 1) % n] = (b[0] + nx * dist, b[1] + ny * dist)
    return out


def door_strips(level, z, kept, kinds_ok):
    """Ô cửa đi giữa hai phòng khô (VD ngủ ↔ khách): chữ nhật = lỗ cửa đo trên khối tường Revit (dọc tim tường, cao
    Level + PROBE_Z_MM) × bề dày tường (mặt hoàn thiện ↔ mặt hoàn thiện). → [(đỉnh mm, phòng +n, phòng −n, cửa)]."""
    opts = SolidCurveIntersectionOptions()
    opts.ResultType = SolidCurveIntersectionMode.CurveSegmentsInside
    zc = z + from_mm(PROBE_Z_MM)
    span = from_mm(3000)

    def piece_at(pt):
        for p in kept:
            if p.box[0] <= pt[0] <= p.box[2] and p.box[1] <= pt[1] <= p.box[3] and in_region(pt, p.outer, p.holes):
                return p
        return None

    result = []
    for d in FilteredElementCollector(doc).OfCategory(BuiltInCategory.OST_Doors).WhereElementIsNotElementType():
        w = getattr(d, "Host", None)
        if not isinstance(d, FamilyInstance) or not isinstance(w, Wall) or not isinstance(d.Location, LocationPoint):
            continue
        if not isinstance(w.Location, LocationCurve) or not isinstance(w.Location.Curve, Line):
            continue
        lc = w.Location.Curve
        u = XYZ(lc.Direction.X, lc.Direction.Y, 0).Normalize()
        n = XYZ(-u.Y, u.X, 0)
        p0 = lc.GetEndPoint(0)
        p = d.Location.Point
        t = (p.X - p0.X) * u.X + (p.Y - p0.Y) * u.Y
        c = XYZ(p0.X + u.X * t, p0.Y + u.Y * t, zc)
        probe = Line.CreateBound(c.Subtract(u.Multiply(span)), c.Add(u.Multiply(span)))
        lo, hi, blocked = -span, span, False
        for o in w.get_Geometry(Options()):
            if not isinstance(o, Solid) or o.Volume <= 0:
                continue
            r = o.IntersectWithCurve(probe, opts)
            for i in range(r.SegmentCount):
                sg = r.GetCurveSegment(i)
                s0 = sg.GetEndPoint(0).Subtract(c).DotProduct(u)
                s1 = sg.GetEndPoint(1).Subtract(c).DotProduct(u)
                s0, s1 = min(s0, s1), max(s0, s1)
                if s1 <= 1e-6:
                    lo = max(lo, s1)
                elif s0 >= -1e-6:
                    hi = min(hi, s0)
                else:
                    blocked = True
        if blocked or lo <= -span or hi >= span or not (from_mm(300) <= hi - lo <= from_mm(3000)):
            continue
        h = w.Width / 2.0
        probe_mm = to_mm(h) + 150.0
        cx, cy = to_mm(c.X), to_mm(c.Y)
        pa = piece_at((cx + n.X * probe_mm, cy + n.Y * probe_mm))
        pb = piece_at((cx - n.X * probe_mm, cy - n.Y * probe_mm))
        if pa is None or pb is None or pa.kind not in kinds_ok or pb.kind not in kinds_ok:
            continue
        rect = [(to_mm(c.X + u.X * s + n.X * k), to_mm(c.Y + u.Y * s + n.Y * k))
                for s, k in ((lo, -h), (hi, -h), (hi, h), (lo, h))]
        result.append((clean_poly(rect), pa, pb, d))
    return result


def preview_lines(regions, z_mm):
    try:
        clr.AddReference("ProtoGeometry")
        from Autodesk.DesignScript.Geometry import Point as DSPoint, Line as DSLine
        out = []
        for outer, holes in regions:
            for loop in [outer] + holes:
                for i in range(len(loop)):
                    a, b = loop[i], loop[(i + 1) % len(loop)]
                    out.append(DSLine.ByStartPointEndPoint(DSPoint.ByCoordinates(a[0], a[1], z_mm),
                                                           DSPoint.ByCoordinates(b[0], b[1], z_mm)))
        return out
    except Exception:
        return []


LOG_HEADER = [u"Căn", u"Phòng", u"Loại", u"Điểm trong phòng (mm)", u"Floor type", u"Cao độ (mm)",
              u"DT vùng (m²)", u"DT sàn (m²)", u"Vùng", u"Kết quả", u"ElementId"]


def write_log(rows, source, dry_run):
    folder = os.path.join(os.path.expanduser("~"), "Documents", "ARV_Logs")
    if not os.path.isdir(folder):
        os.makedirs(folder)
    stamp = datetime.datetime.now().strftime("%Y%m%d_%H%M%S")
    path = os.path.join(folder, "TaoSanCanHoTuCAD_{}_{}.csv".format("DRYRUN" if dry_run else "THUCHIEN", stamp))
    with io.open(path, "w", encoding="utf-8-sig", newline="") as f:
        f.write(u"# Dự án: {}\n".format(doc.Title))
        f.write(u"# Bản CAD: {}\n".format(source))
        f.write(u"# Ngày xuất: {}\n".format(datetime.datetime.now().strftime("%Y-%m-%d %H:%M")))
        f.write(u"# Chế độ: {}\n".format(u"Chạy thử (dry-run)" if dry_run else u"Thực hiện"))
        f.write(u"# Đơn vị: mm, m²\n")
        w = csv.writer(f)
        w.writerow(LOG_HEADER)
        w.writerows(rows)
    return path


class Piece(object):
    def __init__(self, apt, outer, holes, is_open):
        self.apt = apt
        self.outer = outer
        self.holes = holes
        self.is_open = is_open
        self.area = (abs(signed_area(outer)) - sum(abs(signed_area(h)) for h in holes)) / 1e6
        self.ip = interior_point(outer, holes)
        self.box = bbox(outer)
        self.kind = None
        self.label = u""
        self.status = u""
        self.floor_outer = outer
        self.floor_area = self.area
        self.id = u""
        self.tag = None           # Hậu tố Comments (mặc định = loại)
        self.bo_loops = None      # Vòng vẽ đường bo (mặc định = biên sàn); sàn gộp → bo theo từng phòng thành phần
        self.merged = False       # Phòng đã gộp vào tấm sàn khô chung của căn (không tạo tấm riêng)


# --- Chương trình chính -----------------------------------------------------------
def main(cad_filter, apt_filters, name_filters, name_pattern, col_filters, col_gap, logia_filters, logia_probe,
         wc_filters, type_text, offset_text, wc_extra, only_text, dry_run, template_name=u"", line_style_name=u"", rebuild=False):
    if is_central_file(doc):
        raise StopReport([u"DỪNG: đang mở file CENTRAL. Mở file local / bản sao rồi chạy lại."])
    view = doc.ActiveView
    if not isinstance(view, ViewPlan) or view.GenLevel is None:
        raise StopReport([u"DỪNG: mở view MẶT BẰNG của tầng cần tạo sàn (sàn tạo trên level của view) rồi Run."])
    level = view.GenLevel
    z = level.Elevation
    warns = []

    # Floor type + cao độ
    type_map = parse_map(type_text)
    offsets = {}
    for k, v in parse_map(offset_text).items():
        try:
            offsets[k] = float(v)
        except ValueError:
            raise StopReport([u"DỪNG: cao độ '{}={}' ở IN[10] không phải số.".format(k, v)])
    all_types = {norm(type_name(t)): t for t in FilteredElementCollector(doc).OfClass(FloorType).ToElements()}
    template = all_types.get(norm(template_name)) if template_name else None
    if template_name and template is None:
        raise StopReport([u"DỪNG: không có floor type mẫu '{}' (IN[14]). Các floor type: {}".format(
            template_name, u", ".join(sorted(all_types.keys())))])
    ftypes, pending = {}, {}
    for k in KINDS:
        name = norm(type_map.get(k, u""))
        if not name:
            warns.append(u"Chưa gán floor type cho {} (IN[9]) – phòng loại này chỉ báo cáo".format(k))
            continue
        if name in all_types:
            ftypes[k] = all_types[name]
        elif template is not None:
            # Chưa có → nhân bản từ type mẫu khi ghi; dry-run tạm dùng type mẫu
            pending[k] = name
            ftypes[k] = template
        else:
            raise StopReport([u"DỪNG: không có floor type '{}' ({}) và chưa có type mẫu để nhân bản (IN[14]). "
                              u"Các floor type: {}".format(name, k, u", ".join(sorted(all_types.keys())))])

    def ft_label(k):
        if k in pending:
            return u"{} (sẽ nhân bản từ {})".format(pending[k], type_name(template))
        return type_name(ftypes[k])

    # CAD
    inst = pick_cad(cad_filter)
    cad_name = get_name(doc.GetElement(inst.GetTypeId()))
    apts, cols, wc_pts = read_link_geometry(inst, apt_filters, col_filters, wc_filters)
    if not apts:
        raise StopReport([u"DỪNG: bản CAD '{}' không có polyline kín ≥ {:.0f} m² trên layer '{}' (IN[1]).".format(
            cad_name, MIN_APT_M2, u";".join(apt_filters))])

    # Tên căn
    names = {}
    path = cad_file_path(inst)
    core = find_accoreconsole()
    if path and os.path.isfile(path) and core:
        tf = inst.GetTotalTransform()
        rx = re.compile(name_pattern or u".+", re.IGNORECASE)
        labels = []
        for lay, text, x, y in read_dwg_texts(path, core):
            text = norm(text)
            if matches(lay, name_filters) and rx.search(text):
                p = tf.OfPoint(XYZ(from_mm(x), from_mm(y), 0))
                labels.append((text, (to_mm(p.X), to_mm(p.Y))))
        names = match_names(labels, apts)
        if not labels:
            warns.append(u"Không có chữ tên căn khớp '{}' trên layer '{}' – đặt tên căn theo vị trí".format(
                name_pattern, u";".join(name_filters)))
        else:
            if len(names) < len(labels):
                warns.append(u"{} tên căn không ghép được polyline (cách > {:.0f} mm): {}".format(
                    len(labels) - len(names), MAX_LABEL_MM,
                    u", ".join(sorted(set(t for t, _ in labels) - set(names.values())))))
            unnamed = [i for i in range(len(apts)) if i not in names]
            if unnamed:
                warns.append(u"Bỏ {} polyline không có tên căn (hành lang / sảnh): {}".format(
                    len(unnamed), u", ".join(u"{:.1f} m²".format(abs(signed_area(apts[i])) / 1e6) for i in unnamed)))
    else:
        warns.append(u"Không đọc được chữ trong DWG (thiếu file gốc hoặc AutoCAD Core Console) – đặt tên căn theo vị trí")
    if not names:
        order = sorted(range(len(apts)), key=lambda i: (-round(bbox(apts[i])[3] / 1000.0), bbox(apts[i])[0]))
        names = {i: u"CAN-{:02d}".format(n) for n, i in enumerate(order, 1)}

    only = set(norm(s).upper() for s in split_filters(only_text))
    targets = [i for i in sorted(names) if not only or names[i].upper() in only]
    if not targets:
        raise StopReport([u"DỪNG: không có căn nào khớp IN[12] '{}'. Các căn: {}".format(
            only_text, u", ".join(sorted(names.values())))])

    # Vùng bao các căn − tường − cột → các vùng rời
    boxes = [bbox(apts[i]) for i in targets]
    x0 = min(b[0] for b in boxes) - MARGIN_MM
    y0 = min(b[1] for b in boxes) - MARGIN_MM
    x1 = max(b[2] for b in boxes) + MARGIN_MM
    y1 = max(b[3] for b in boxes) + MARGIN_MM
    region = prism(poly_loop([(x0, y0), (x1, y0), (x1, y1), (x0, y1)], z), 1.0)
    cutters = wall_cutters(level, z, warns) + column_cutters(cols, col_gap, z)
    fails = 0
    for c in cutters:
        try:
            region = BooleanOperationsUtils.ExecuteBooleanOperation(region, c, BooleanOperationsType.Difference)
        except Exception:
            fails += 1
    if fails:
        warns.append(u"{} khối tường / cột không trừ được (lỗi boolean) – soát biên sàn quanh đó".format(fails))

    apt_prisms = {i: prism(poly_loop(apts[i], z - 0.5), 2.0) for i in targets}
    pieces, skipped = [], []
    for sol in SolidUtils.SplitVolumes(region):
        for outer, holes in solid_regions(sol):
            ip = interior_point(outer)
            home = [i for i in targets if point_in(ip, apts[i])]
            if home and max(dist_outside(p, apts[home[0]]) for p in outer) <= OPEN_MM:
                pieces.append(Piece(home[0], outer, holes, False))
                continue
            # Vùng hở: cắt theo từng polyline căn chạm tới (phần cắt ra bằng nguyên vùng → thực chất là vùng kín)
            whole = (abs(signed_area(outer)) - sum(abs(signed_area(h)) for h in holes)) / 1e6
            bb = bbox(outer)
            for i in targets:
                if not bbox_overlap(bb, boxes[targets.index(i)]):
                    continue
                try:
                    part = BooleanOperationsUtils.ExecuteBooleanOperation(sol, apt_prisms[i],
                                                                          BooleanOperationsType.Intersect)
                except Exception:
                    warns.append(u"Không cắt được vùng hở theo căn {}".format(names[i]))
                    continue
                if part is None or part.Volume <= 0:
                    continue
                for sub in SolidUtils.SplitVolumes(part):
                    for o2, h2 in solid_regions(sub):
                        p = Piece(i, o2, h2, True)
                        p.is_open = abs(p.area - whole) > 0.05
                        pieces.append(p)

    # Lọc vùng nhỏ / dải mảnh
    kept = []
    for p in pieces:
        if p.area < MIN_PIECE_M2:
            skipped.append((p, u"< {:.1f} m² (hộp kỹ thuật)".format(MIN_PIECE_M2)))
        elif 2.0 * p.area * 1e6 / perimeter(p.outer) < MIN_WIDTH_MM:
            skipped.append((p, u"dải mảnh rộng TB < {:.0f} mm".format(MIN_WIDTH_MM)))
        else:
            kept.append(p)

    # Phân loại
    logia_pts = []
    for d in FilteredElementCollector(doc).OfCategory(BuiltInCategory.OST_Doors).WhereElementIsNotElementType():
        if not isinstance(d, FamilyInstance) or not isinstance(d.Location, LocationPoint):
            continue
        if d.LevelId != level.Id or not matches(d.Symbol.Family.Name + u" " + type_name(d.Symbol), logia_filters):
            continue
        p = d.Location.Point.Add(d.FacingOrientation.Multiply(from_mm(logia_probe)))
        logia_pts.append((to_mm(p.X), to_mm(p.Y)))
    if logia_filters and not logia_pts:
        warns.append(u"Không có cửa ra logia khớp '{}' (IN[6]) trên level – không nhận được logia".format(
            u";".join(logia_filters)))
    def count_in(pts, p):
        x0, y0, x1, y1 = p.box
        return sum(1 for q in pts if x0 <= q[0] <= x1 and y0 <= q[1] <= y1 and in_region(q, p.outer, p.holes))

    for p in kept:
        n_wc = count_in(wc_pts, p)
        n_lg = count_in(logia_pts, p)
        if n_lg:
            p.kind, p.label = "LOGIA", u"Logia"
        elif n_wc >= WC_MIN_PTS:
            p.kind, p.label = "WC", u"WC"
            if p.area > WC_MAX_M2:
                p.kind, p.status = None, u"KIỂM TRA: có thiết bị WC nhưng {:.2f} m² > {:.0f} m² (thiếu tường?)".format(
                    p.area, WC_MAX_M2)
        elif p.is_open and p.area <= OPEN_LOGIA_MAX_M2:
            # Vùng nhỏ không có tường Revit bao kín (hở ra ngoài, đóng theo polyline căn) = logia giặt / phơi
            # (KTS chốt 2026-10-19: khu đặt máy giặt G19 là logia – cửa đi mở quay, không phải cửa trượt)
            p.kind, p.label = "LOGIA", u"Logia (vùng hở)"
            p.status = u"Lưu ý: logia nhận theo vùng hở ≤ {:.0f} m² – soát".format(OPEN_LOGIA_MAX_M2)
        else:
            p.kind = "KHO"
    for i in targets:
        dry = sorted([p for p in kept if p.apt == i and p.kind == "KHO"], key=lambda p: -p.area)
        for n, p in enumerate(dry):
            p.label = u"Khách" if n == 0 else (u"Ngủ" if p.area >= BEDROOM_MIN_M2 else u"Sảnh / kho")
            if p.is_open:
                p.label += u" (vùng hở)"
                if n > 0:
                    p.status = u"Lưu ý: vùng hở theo polyline căn – soát tường / cửa"

    # Sàn ô cửa: hai bên phòng khô (ngủ ↔ khách) → sàn phòng khô; phòng khô ↔ WC → đá chân cửa (CHANCUA)
    n_doors = n_sills = 0
    for rect, pa, pb, d in door_strips(level, z, kept, ("KHO", "WC")):
        if len(rect) < 3:
            continue
        if pa.kind == "KHO" and pb.kind == "KHO":
            s = Piece(pa.apt, rect, [], False)
            s.kind, s.label, s.tag = "KHO", u"Ô cửa {} ↔ {}".format(pa.label, pb.label), u"KHO-CUA"
            n_doors += 1
        elif "WC" in (pa.kind, pb.kind) and "KHO" in (pa.kind, pb.kind):
            wc, dry = (pa, pb) if pa.kind == "WC" else (pb, pa)
            if wc_extra > 0:
                # Kéo đá thêm wc_extra về phía WC cho khít mép sàn WC (WC lùi biên thêm wc_extra)
                rect = extend_toward(rect, wc.ip, wc_extra)
            s = Piece(dry.apt, rect, [], False)
            s.kind, s.label, s.tag = "CHANCUA", u"Đá chân cửa WC", u"CHANCUA"
            n_sills += 1
        else:
            continue
        kept.append(s)

    # Gộp sàn khô mỗi căn (khách + ô cửa + phòng ngủ nối qua cửa) thành 1 tấm → mạch ván liền nhau
    # (KTS chốt 2026-10-20: mỗi tấm Revit tự đặt gốc mẫu hatch theo hình của nó, API không dời được gốc mẫu)
    # Chiều hatch: song song cạnh dài nhất phòng khách (force_dir).
    merge_warns = []
    for i in targets:
        rooms = [p for p in kept if p.apt == i and p.kind == "KHO" and p.tag is None]
        if not rooms:
            continue
        ang = edge_dir(max(rooms, key=lambda p: p.area).outer)
        dry = [p for p in kept if p.apt == i and p.kind == "KHO"]
        groups = []
        if len(dry) > 1:
            try:
                sol = None
                for p in dry:
                    loops = [poly_loop(p.outer, z)] + [poly_loop(h[::-1], z) for h in p.holes]
                    s = GeometryCreationUtilities.CreateExtrusionGeometry(List[CurveLoop](loops), XYZ.BasisZ, 1.0)
                    sol = s if sol is None else BooleanOperationsUtils.ExecuteBooleanOperation(
                        sol, s, BooleanOperationsType.Union)
                for comp in SolidUtils.SplitVolumes(sol):
                    for outer, holes in solid_regions(comp):
                        members = [p for p in dry if in_region(p.ip, outer, holes)]
                        if len(members) > 1:
                            groups.append((outer, holes, members))
            except Exception as ex:
                groups = []
                merge_warns.append(u"{}: không gộp được sàn khô ({}) – để tấm riêng, mạch có thể lệch".format(
                    names[i], ex))
        for outer, holes, members in groups:
            g = Piece(i, outer, holes, any(p.is_open for p in members))
            n_bed = sum(1 for p in members if p.tag is None) - 1
            n_cua = sum(1 for p in members if p.tag is not None)
            g.kind, g.label = "KHO", u"Sàn khô gộp (khách + {} phòng + {} ô cửa)".format(n_bed, n_cua)
            g.bo_loops = [l for p in members if p.tag is None for l in [p.outer] + p.holes]
            for p in members:
                p.merged = True
                p.status = u"Gộp vào sàn khô chung của căn"
            kept.append(g)
        for p in kept:
            if p.apt == i and p.kind == "KHO" and not p.merged:
                p.floor_outer = force_dir(p.floor_outer, ang)

    # Sàn đã có (hoặc xoá để tạo lại), WC lùi biên
    existing = existing_floor_polys(level)
    target_names = set(names[i] for i in targets)
    old_floors = {}
    if rebuild:
        for poly, fid, apt, fl in existing:
            if apt in target_names:
                old_floors[fid] = fl
        existing = [e for e in existing if e[1] not in old_floors]
    warns += merge_warns
    jobs = []
    for p in kept:
        if p.kind is None or p.merged:
            continue
        if p.kind not in ftypes:
            p.status = u"Chưa gán floor type"
            continue
        old = [e[1] for e in existing if point_in(p.ip, e[0])]
        if old:
            p.status, p.id = u"Bỏ qua: đã có sàn", old[0]
            continue
        if p.kind == "WC" and wc_extra > 0:
            o = offset_outer(p.outer, wc_extra, z)
            if o is None:
                p.status = u"LỖI lùi biên WC"
                continue
            p.floor_outer = o
            p.floor_area = (abs(signed_area(o)) - sum(abs(signed_area(h)) for h in p.holes)) / 1e6
        p.status = u"Sẽ tạo" if dry_run else u"Chờ tạo"
        jobs.append(p)

    # Line style đường bo (phải có sẵn – không tạo mới)
    line_style = None
    if line_style_name:
        subs = list(doc.Settings.Categories.get_Item(BuiltInCategory.OST_Lines).SubCategories)
        hit = [s for s in subs if norm(s.Name) == norm(line_style_name)]
        if not hit:
            raise StopReport([u"DỪNG: không có line style '{}' (IN[15]). Các line style: {}".format(
                line_style_name, u", ".join(sorted(s.Name for s in subs)))])
        line_style = hit[0].GetGraphicsStyle(GraphicsStyleType.Projection)

    # Ghi vào mô hình
    created_errors, created_types, line_errors = [], [], []
    n_lines = n_del_lines = n_kept_lines = 0
    drawn = set()
    step = [u"chuẩn bị"]
    if not dry_run and jobs:
        TransactionManager.Instance.ForceCloseTransaction()
        tx = Transaction(doc, TRANSACTION_NAME)
        tx.Start()
        try:
            # Đường bo đã có: Detail Line cùng line style trên view đang mở, theo vị trí 2 đầu mút (mm)
            old_lines = {}
            if line_style is not None:
                step[0] = u"đọc đường bo đã có"
                for ce in FilteredElementCollector(doc, view.Id).OfCategory(BuiltInCategory.OST_Lines) \
                        .WhereElementIsNotElementType():
                    try:
                        if ce.LineStyle.Id != line_style.Id:
                            continue
                        gc = ce.GeometryCurve
                    except Exception:
                        continue
                    a, b = gc.GetEndPoint(0), gc.GetEndPoint(1)
                    old_lines.setdefault(seg_key((to_mm(a.X), to_mm(a.Y)), (to_mm(b.X), to_mm(b.Y))), []).append(ce.Id)
            if rebuild:
                # Xoá sàn cũ của tool + mọi nét đường bo trùng cạnh sàn cũ / sàn sắp tạo (kể cả nét bị nhân đôi)
                step[0] = u"xoá sàn + đường bo cũ"
                edges = set()
                loops = [e[0] for e in existing_floor_polys(level) if e[1] in old_floors]
                for p in jobs:
                    loops += [p.floor_outer] + p.holes + (p.bo_loops or [])
                for pts in loops:
                    for k in range(len(pts)):
                        edges.add(seg_key(pts[k], pts[(k + 1) % len(pts)]))
                # + mọi nét cùng line style nằm trong các căn đang làm (2 đầu mút cách polyline căn ≤ 300 mm):
                # nét bo của lần chạy trước có thể lệch vị trí (sàn đã xoá tay) → không còn trùng cạnh nào
                for k in list(old_lines.keys()):
                    ends = list(k) if len(k) == 2 else list(k) * 2
                    if any(all(dist_outside(e, apts[i]) <= 300.0 for e in ends) for i in targets):
                        edges.add(k)
                line_ids = [i for k in edges for i in old_lines.pop(k, [])]
                n_del_lines = len(line_ids)
                dels = [old_floors[f].Id for f in old_floors] + line_ids
                if dels:
                    doc.Delete(List[ElementId](dels))
            drawn = set(old_lines.keys())
            step[0] = u"nhân bản floor type"
            for k in sorted(set(pending) & set(p.kind for p in jobs)):
                name = pending.pop(k)
                ftypes[k] = template.Duplicate(name)
                created_types.append(u"{} = '{}' (nhân bản từ '{}')".format(k, name, type_name(template)))
            for p in jobs:
                step[0] = u"tạo sàn {} {} {}".format(names[p.apt], p.label or p.kind, fmt(p.ip))
                loops = [poly_loop(p.floor_outer, z)] + [poly_loop(h[::-1], z) for h in p.holes]
                try:
                    try:
                        fl = Floor.Create(doc, List[CurveLoop](loops), ftypes[p.kind].Id, level.Id)
                    except Exception:
                        # Biên đã chia cạnh (chỉnh chiều hatch) bị Revit từ chối → tạo theo biên gốc, báo lệch chiều
                        clean = clean_poly(p.floor_outer)
                        if len(clean) == len(p.floor_outer):
                            raise
                        p.floor_outer = clean
                        loops = [poly_loop(p.floor_outer, z)] + [poly_loop(h[::-1], z) for h in p.holes]
                        fl = Floor.Create(doc, List[CurveLoop](loops), ftypes[p.kind].Id, level.Id)
                        line_errors.append(u"{} {} {}: không chỉnh được chiều hatch – xoay tay (Align)".format(
                            names[p.apt], p.label, fmt(p.ip)))
                except Exception as ex:
                    p.status = u"LỖI Floor.Create: {}".format(ex)
                    created_errors.append(p)
                    continue
                fl.get_Parameter(BuiltInParameter.FLOOR_HEIGHTABOVELEVEL_PARAM).Set(from_mm(offsets.get(p.kind, 0.0)))
                cm = fl.get_Parameter(BuiltInParameter.ALL_MODEL_INSTANCE_COMMENTS)
                if cm is not None and not cm.IsReadOnly:
                    cm.Set(u"{} {} {}".format(COMMENT_TAG, names[p.apt], p.tag or p.kind))
                p.status, p.id = u"Đã tạo", id_value(fl.Id)
                if line_style is not None:
                    # Đường bo phòng = biên tấm sàn vừa tạo, vẽ Detail Line trên view đang mở.
                    # Đoạn đã có nét cùng line style trùng đúng vị trí (lần chạy trước, sàn bị xoá tay) → không vẽ lại.
                    for loop in (p.bo_loops if p.bo_loops is not None else [p.floor_outer] + p.holes):
                        for i in range(len(loop)):
                            a, b = loop[i], loop[(i + 1) % len(loop)]
                            key = seg_key(a, b)
                            if key in drawn:
                                n_kept_lines += 1
                                continue
                            try:
                                dc = doc.Create.NewDetailCurve(view, Line.CreateBound(
                                    XYZ(from_mm(a[0]), from_mm(a[1]), z), XYZ(from_mm(b[0]), from_mm(b[1]), z)))
                                dc.LineStyle = line_style
                                drawn.add(key)
                                n_lines += 1
                            except Exception as ex:
                                line_errors.append(u"{} {}–{}: {}".format(names[p.apt], fmt(a), fmt(b), ex))
            tx.Commit()
        except Exception as ex:
            import traceback
            tx.RollBack()
            lines = [u"LỖI khi ghi vào mô hình (bước: {}), mọi thay đổi đã được hoàn tác: {}".format(step[0], ex),
                     traceback.format_exc()]
            try:
                folder = os.path.join(os.path.expanduser("~"), "Documents", "ARV_Logs")
                path = os.path.join(folder, "TaoSanCanHoTuCAD_LOI_{}.txt".format(
                    datetime.datetime.now().strftime("%Y%m%d_%H%M%S")))
                with io.open(path, "w", encoding="utf-8-sig") as f:
                    f.write(u"\n".join(lines))
                lines.append(u"Log lỗi: " + path)
            except Exception:
                pass
            return lines, []

    # Báo cáo
    rows = []
    allp = sorted(kept, key=lambda p: (names[p.apt], {"KHO": 0, "WC": 1, "LOGIA": 2, "CHANCUA": 3}.get(p.kind, 4), -p.area))
    for p in allp:
        rows.append([names[p.apt], p.label or u"—", p.kind or u"—", fmt(p.ip),
                     ft_label(p.kind) if p.kind in ftypes else u"—",
                     u"{:.0f}".format(offsets.get(p.kind, 0.0)) if p.kind else u"—",
                     u"{:.2f}".format(p.area), u"{:.2f}".format(p.floor_area),
                     u"hở" if p.is_open else u"kín", p.status, p.id])
    for p, why in skipped:
        rows.append([names[p.apt], u"—", u"bỏ", fmt(p.ip), u"—", u"—", u"{:.2f}".format(p.area), u"—",
                     u"hở" if p.is_open else u"kín", u"Bỏ qua: " + why, u""])

    report = [u"{} – {}".format(TRANSACTION_NAME, u"CHẠY THỬ (không ghi vào mô hình)" if dry_run else u"ĐÃ THỰC HIỆN")]
    report.append(u"CAD: {} – level: {} – {} căn ({})".format(
        cad_name, level.Name, len(targets), u", ".join(sorted(names[i] for i in targets))))
    counts = {}
    for p in jobs:
        counts[p.kind] = counts.get(p.kind, 0) + 1
    report.append(u"Tấm sàn {}: {} (khô {}, WC {}, logia {}) – bỏ qua vùng nhỏ / mảnh: {}".format(
        u"sẽ tạo" if dry_run else u"đã tạo", len(jobs) - len(created_errors), counts.get("KHO", 0),
        counts.get("WC", 0), counts.get("LOGIA", 0), len(skipped)))
    report.append(u"Ô cửa: {} ô ngủ ↔ khách (sàn phòng khô, …KHO-CUA) + {} đá chân cửa WC (CHANCUA)".format(
        n_doors, n_sills))
    report.append(u"Chiều hatch sàn khô: mỗi căn song song cạnh dài nhất của phòng khách (ngủ + khách + ô cửa)")
    if rebuild:
        report.append(u"Tạo lại: {} {} sàn cũ của tool trong các căn đang làm{}".format(
            u"sẽ xoá" if dry_run else u"đã xoá", len(old_floors),
            u" + các đoạn đường bo trùng cạnh (kể cả nét nhân đôi)" if dry_run else
            u" + {} đoạn đường bo trùng cạnh".format(n_del_lines)))
    if line_style is not None:
        report.append(u"Đường bo phòng (Detail Line '{}', view '{}'): {}".format(
            line_style_name, view.Name, u"vẽ theo biên các tấm sàn sẽ tạo" if dry_run else
            u"vẽ mới {} đoạn, giữ {} đoạn đã có trùng vị trí, quanh {} tấm sàn".format(
                n_lines, n_kept_lines, len(jobs) - len(created_errors))))
        for e in line_errors[:10]:
            report.append(u"CẢNH BÁO đường bo: " + e)
    if dry_run:
        report.insert(1, u">>> ĐANG CHẠY THỬ: chưa ghi gì vào mô hình. Muốn tạo sàn: đổi ô IN[13] Dry-run = False "
                         u"(không phải IN[16] Tạo lại) rồi Run.")
    for line in created_types:
        report.append(u"ĐÃ NHÂN BẢN floor type: " + line)
    for k in sorted(pending):
        report.append(u"Floor type {} = '{}' chưa có → {} từ '{}'".format(
            k, pending[k], u"sẽ nhân bản khi chạy thật" if dry_run else u"không có tấm sàn dùng, không nhân bản",
            type_name(template)))
    for i in targets:
        ks = [p.kind for p in kept if p.apt == i]
        if "LOGIA" not in ks:
            warns.append(u"{}: không nhận được logia".format(names[i]))
        if "WC" not in ks:
            warns.append(u"{}: không nhận được WC".format(names[i]))
    checks = [p for p in kept if p.status.startswith(u"KIỂM TRA") or p.status.startswith(u"LỖI")]
    for p in checks:
        warns.append(u"{} {}: {}".format(names[p.apt], fmt(p.ip), p.status))
    for w in warns:
        report.append(u"CẢNH BÁO: " + w)
    try:
        report.append(u"Log: " + write_log(rows, cad_name, dry_run))
    except Exception as ex:
        report.append(u"Không ghi được file log: {}".format(ex))
    if dry_run:
        report.append(u"Kiểm tra biên sàn (OUT[1]) + log. Đúng thì đổi Dry-run = False và Run lại. "
                      u"Undo bằng mục \"{}\".".format(TRANSACTION_NAME))
    report.append(u" | ".join(LOG_HEADER))
    report += [u" | ".join(u"{}".format(v) for v in r) for r in rows]
    return report, preview_lines([(p.floor_outer, p.holes) for p in jobs], to_mm(z))


def force_rerun_next_time():
    """Đánh dấu node 'đã sửa' để lần Run sau luôn chạy lại (chỉ ở chế độ Manual)."""
    try:
        clr.AddReference("DynamoRevitDS")
        from Dynamo.Applications import DynamoRevit
        ws = DynamoRevit.RevitDynamoModel.CurrentWorkspace
        rt = ws.RunSettings.RunType
        try:
            clr.AddReference("DynamoCore")
            from Dynamo.Models import RunType
            manual = rt == RunType.Manual
        except Exception:
            manual = False
        if not (manual or str(rt) in ("0", "Manual", "RunType.Manual")):
            return u"Chế độ chạy không phải Manual – lần sau phải đổi một ô đầu vào thì node mới chạy lại."
        for n in ws.Nodes:
            if SCRIPT_TAG in (getattr(n, "Script", None) or u""):
                n.MarkNodeAsModified(True)
                return None
        return u"Không tìm thấy node để đánh dấu chạy lại."
    except Exception as ex:
        return u"Không đánh dấu được node chạy lại ({}) – lần sau đổi một ô đầu vào rồi Run.".format(ex)


def num(v, default):
    try:
        return float(v)
    except (TypeError, ValueError):
        return default


if DYNAMO:
    import traceback
    try:
        OUT = list(main(
            (IN[0] or u"").strip(),
            split_filters(IN[1] or u"00 do dt"),
            split_filters(IN[2] or u"A-Text"),
            (IN[3] or u"^CH\\d+").strip(),
            split_filters(IN[4] if IN[4] is not None else u"A-Column"),
            num(IN[5], 15.0),
            split_filters(IN[6] if IN[6] is not None else u"trượt"),
            num(IN[7], 400.0),
            split_filters(IN[8] if IN[8] is not None else u"A-Interior WC"),
            IN[9] or (u"KHO=SHT-Gỗ Công Nghiệp;WC=SHT-Gach Lat WC-300x600;LOGIA=SHT-Gach Lat Logia-300x600;"
                      u"CHANCUA=FF-Đá Granite tự nhiên"),
            IN[10] or u"KHO=0;WC=-15;LOGIA=-30;CHANCUA=0",
            num(IN[11], 10.0),
            IN[12] or u"",
            True if IN[13] is None else bool(IN[13]),
            (IN[14] if len(IN) > 14 and IN[14] is not None else u"SHT-Gach Lat-600x600").strip(),
            (IN[15] if len(IN) > 15 and IN[15] is not None else u"AV.Nét Hatch Lát Sàn").strip(),
            False if len(IN) <= 16 or IN[16] is None else bool(IN[16]),
        ))
    except StopReport as ex:
        OUT = [ex.lines, []]
    except Exception as ex:
        OUT = [[u"LỖI: {}".format(ex), traceback.format_exc()], []]
        try:
            folder = os.path.join(os.path.expanduser("~"), "Documents", "ARV_Logs")
            if not os.path.isdir(folder):
                os.makedirs(folder)
            with io.open(os.path.join(folder, "TaoSanCanHoTuCAD_LOI_{}.txt".format(
                    datetime.datetime.now().strftime("%Y%m%d_%H%M%S"))), "w", encoding="utf-8-sig") as f:
                f.write(u"\n".join(OUT[0]))
        except Exception:
            pass
    note = force_rerun_next_time()
    if note:
        OUT[0].append(u"LƯU Ý: " + note)
# ----------------------------------------

# group: 3. Báo cáo
# Tóm tắt, cảnh báo, đường dẫn log, từng tấm sàn. Biên sàn xem trước hiện trên nền 3D Dynamo.
báo_cáo = Watch(tạo_sàn_căn_hộ_python)
